# Grasshopper definition Cuttlefish-Examples.gh (Grasshopper 1.0.8)
# plug-ins: Cuttlefish, Cordyceps

# ---- group: CreateGrid
# Cuttlefish examples. One group per component; each example is drawn in its own 100 x 100 square in Rhino, in the order of the groups (5 per row).
panel = Panel("{0,0,0}")
number_slider = Slider(100, range=10..200)
rectangle = Rectangle(Plane=panel, XSize=number_slider, YSize=number_slider, Radius=0)  # -> Rectangle, Length
grid = CreateGrid(Rectangle=rectangle.Rectangle, CellMaxSizeX=10, CellMaxSizeY=10)

# ---- group: CircularGrid
number_slider_2 = Slider(100, range=10..200)
rectangle_2 = Rectangle(Plane="{140,0,0}", XSize=number_slider_2, YSize=number_slider_2, Radius=0)  # -> Rectangle, Length
cir = Circle(Plane="{190,50,0}", Radius=Slider(48, range=1..50))
cirgrid = CircularGrid(Circle=cir, DensityByCircle=10, DensityOfCircle=10)

# ---- group: Attractor
number_slider_3 = Slider(100, range=10..200)
rectangle_3 = Rectangle(Plane="{280,0,0}", XSize=number_slider_3, YSize=number_slider_3, Radius=0)  # -> Rectangle, Length
cir_2 = Circle(Plane="{330,50,0}", Radius=Slider(22, range=1..50))
grid_2 = CreateGrid(Rectangle=rectangle_3.Rectangle, CellMaxSizeX=10, CellMaxSizeY=10)
atrk = Attractor(Points=grid_2, Curve=cir_2, AttractionFactor=1, AttractionDistance=25)

# ---- group: Blur
number_slider_4 = Slider(100, range=10..200)
rectangle_4 = Rectangle(Plane="{420,0,0}", XSize=number_slider_4, YSize=number_slider_4, Radius=0)  # -> Rectangle, Length
grid_3 = CreateGrid(Rectangle=rectangle_4.Rectangle, CellMaxSizeX=10, CellMaxSizeY=10)
blr = Blur(Points=grid_3, BlurX=1, BlurY=1, BlurZ=0)

# ---- group: Voronoi
number_slider_5 = Slider(100, range=10..200)
rectangle_5 = Rectangle(Plane="{560,0,0}", XSize=number_slider_5, YSize=number_slider_5, Radius=0)  # -> Rectangle, Length
pop2d = Populate2D(Region=rectangle_5.Rectangle, Count=Slider(60, range=3..200), Seed=1)
voro = Voronoi(Rectangle=rectangle_5.Rectangle, Points=pop2d)

# ---- group: Delaunay
number_slider_6 = Slider(100, range=10..200)
rectangle_6 = Rectangle(Plane="{0,-140,0}", XSize=number_slider_6, YSize=number_slider_6, Radius=0)  # -> Rectangle, Length
pop2d_2 = Populate2D(Region=rectangle_6.Rectangle, Count=Slider(60, range=3..200), Seed=1)
dela = Delaunay(Points=pop2d_2)

# ---- group: Pebble
number_slider_7 = Slider(100, range=10..200)
rectangle_7 = Rectangle(Plane="{140,-140,0}", XSize=number_slider_7, YSize=number_slider_7, Radius=0)  # -> Rectangle, Length
pop2d_3 = Populate2D(Region=rectangle_7.Rectangle, Count=Slider(60, range=3..200), Seed=1)
voro_2 = Voronoi(Rectangle=rectangle_7.Rectangle, Points=pop2d_3)
pebl = Pebble(Cells=voro_2, Offset=1, Radius=2)

# ---- group: Hatch
number_slider_8 = Slider(100, range=10..200)
rectangle_8 = Rectangle(Plane="{280,-140,0}", XSize=number_slider_8, YSize=number_slider_8, Radius=0)  # -> Rectangle, Length
pop2d_4 = Populate2D(Region=rectangle_8.Rectangle, Count=Slider(60, range=3..200), Seed=1)
voro_3 = Voronoi(Rectangle=rectangle_8.Rectangle, Points=pop2d_4)
hatch = Hatch(Cells=voro_3, Spacing=2, Seed=0)

# ---- group: Worm
number_slider_9 = Slider(100, range=10..200)
line = LineSDL(Start="{0,0,0}", Direction=Vector(0, 0, 1), Length=Slider(2, range=0.5..10))
rectangle_9 = Rectangle(Plane="{420,-140,0}", XSize=number_slider_9, YSize=number_slider_9, Radius=0)  # -> Rectangle, Length
pop2d_5 = Populate2D(Region=rectangle_9.Rectangle, Count=Slider(60, range=3..200), Seed=1)
crv = Curve(line)
voro_4 = Voronoi(Rectangle=rectangle_9.Rectangle, Points=pop2d_5)
worm = Worm(Cells=voro_4, Head=crv, Seed=0)

# ---- group: Bubble
number_slider_10 = Slider(100, range=10..200)
rectangle_10 = Rectangle(Plane="{560,-140,0}", XSize=number_slider_10, YSize=number_slider_10, Radius=0)  # -> Rectangle, Length
pop2d_6 = Populate2D(Region=rectangle_10.Rectangle, Count=Slider(60, range=3..200), Seed=1)
bubl = Bubble(Points=pop2d_6, Factor=1)

# ---- group: Truchet
number_slider_11 = Slider(100, range=10..200)
rectangle_11 = Rectangle(Plane="{0,-280,0}", XSize=number_slider_11, YSize=number_slider_11, Radius=0)  # -> Rectangle, Length
grid_4 = CreateGrid(Rectangle=rectangle_11.Rectangle, CellMaxSizeX=10, CellMaxSizeY=10)
truch = Truchet(Points=grid_4, Type=0, Seed=0)

# ---- group: Maze
number_slider_12 = Slider(100, range=10..200)
rectangle_12 = Rectangle(Plane="{140,-280,0}", XSize=number_slider_12, YSize=number_slider_12, Radius=0)  # -> Rectangle, Length
grid_5 = CreateGrid(Rectangle=rectangle_12.Rectangle, CellMaxSizeX=10, CellMaxSizeY=10)
maze = Maze(Points=grid_5, Seed=0)

# ---- group: Wander
number_slider_13 = Slider(100, range=10..200)
rectangle_13 = Rectangle(Plane="{280,-280,0}", XSize=number_slider_13, YSize=number_slider_13, Radius=0)  # -> Rectangle, Length
grid_6 = CreateGrid(Rectangle=rectangle_13.Rectangle, CellMaxSizeX=10, CellMaxSizeY=10)
wand = Wander(Points=grid_6, Radius=Slider(2, range=0..5), Seed=0)

# ---- group: Lining
number_slider_14 = Slider(100, range=10..200)
rectangle_14 = Rectangle(Plane="{420,-280,0}", XSize=number_slider_14, YSize=number_slider_14, Radius=0)  # -> Rectangle, Length
grid_7 = CreateGrid(Rectangle=rectangle_14.Rectangle, CellMaxSizeX=10, CellMaxSizeY=10)
line_2 = Lining(Points=grid_7, LineType=True, Rectangle=rectangle_14.Rectangle)

# ---- group: Meshing
number_slider_15 = Slider(100, range=10..200)
rectangle_15 = Rectangle(Plane="{560,-280,0}", XSize=number_slider_15, YSize=number_slider_15, Radius=0)  # -> Rectangle, Length
grid_8 = CreateGrid(Rectangle=rectangle_15.Rectangle, CellMaxSizeX=10, CellMaxSizeY=10)
net = Meshing(Points=grid_8, LineType=True, Rectangle=rectangle_15.Rectangle)

# ---- group: Dune
number_slider_16 = Slider(100, range=10..200)
rectangle_16 = Rectangle(Plane="{0,-420,0}", XSize=number_slider_16, YSize=number_slider_16, Radius=0)  # -> Rectangle, Length
grid_9 = CreateGrid(Rectangle=rectangle_16.Rectangle, CellMaxSizeX=10, CellMaxSizeY=10)
dune = Dune(Points=grid_9, Radius=Slider(2, range=0..5))

# ---- group: Contour
number_slider_17 = Slider(100, range=10..200)
rectangle_17 = Rectangle(Plane="{140,-420,0}", XSize=number_slider_17, YSize=number_slider_17, Radius=0)  # -> Rectangle, Length
cir_3 = Circle(Plane="{190,-370,0}", Radius=Slider(22, range=1..50))
grid_10 = CreateGrid(Rectangle=rectangle_17.Rectangle, CellMaxSizeX=10, CellMaxSizeY=10)
cont = Contour(Points=grid_10, Attractors=cir_3, Levels=10)

# ---- group: Flow
number_slider_18 = Slider(100, range=10..200)
rectangle_18 = Rectangle(Plane="{280,-420,0}", XSize=number_slider_18, YSize=number_slider_18, Radius=0)  # -> Rectangle, Length
cir_4 = Circle(Plane="{330,-370,0}", Radius=Slider(22, range=1..50))
grid_11 = CreateGrid(Rectangle=rectangle_18.Rectangle, CellMaxSizeX=10, CellMaxSizeY=10)
flow = Flow(Seeds=flatten(grid_11), Guides=cir_4, Step=1, Count=50, Rectangle=rectangle_18.Rectangle)

# ---- group: Spiral
number_slider_19 = Slider(100, range=10..200)
rectangle_19 = Rectangle(Plane="{420,-420,0}", XSize=number_slider_19, YSize=number_slider_19, Radius=0)  # -> Rectangle, Length
cir_5 = Circle(Plane="{470,-370,0}", Radius=Slider(48, range=1..50))
cirgrid_2 = CircularGrid(Circle=cir_5, DensityByCircle=10, DensityOfCircle=10)
spir = Spiral(Points=cirgrid_2)

# ---- group: Weave
number_slider_20 = Slider(100, range=10..200)
rectangle_20 = Rectangle(Plane="{560,-420,0}", XSize=number_slider_20, YSize=number_slider_20, Radius=0)  # -> Rectangle, Length
cir_6 = Circle(Plane="{610,-370,0}", Radius=Slider(22, range=1..50))
grid_12 = CreateGrid(Rectangle=rectangle_20.Rectangle, CellMaxSizeX=10, CellMaxSizeY=10)
line_3 = Lining(Points=grid_12, LineType=True, Rectangle=rectangle_20.Rectangle)
cont_2 = Contour(Points=grid_12, Attractors=cir_6, Levels=10)
weave = Weave(CurvesA=line_3, CurvesB=flatten(cont_2), Gap=1)

# ----
cordyceps = Cordyceps(HttpPort=26929, DebugLevel=0)  # -> About, Status, LastCommand
